# Grasshopper definition Final.gh (Grasshopper 1.0.8)
# plug-ins: RhinoCodePluginGH, Pancake

number_slider = Slider(4, range=0..100)
X = UnitX(Factor=Slider(4, range=0..10))
arrpolar = PolarArray(Geometry=X, Plane=PlaneXY(0, 0, 0), Count=number_slider, Angle=Slider(1.571, range=0..10))  # -> simplify(Geometry), Transform
number_slider_2 = Slider(10, range=0..10)
number_slider_3 = Slider(16, range=0..100)
Z = UnitZ(Factor=Slider(4, range=0..10))
cir = Circle(Plane=PlaneXY(0, 0, 0), Radius=number_slider_2)
arrlinear = LinearArray(Geometry=arrpolar.Geometry, Direction=Z, Count=number_slider_3)  # -> Geometry, Transform
series = Series(Start=Slider(1, range=0..100), Step=1, Count=number_slider)
dom = ConstructDomain(DomainStart=Slider(-2, range=-10..10), DomainEnd=Slider(2, range=0..10))
Z_2 = UnitZ(Factor=1)
scale = Scale(Geometry=cir, Center=Point(0, 0, 0), Factor=0.5)  # -> Geometry, Transform
cir_2 = Circle(Plane=PlaneXY(0, 0, 0), Radius=Slider(8.1, range=0..10))
line = LineSDL(Start=Z_2, Direction=Vector(0, 0, 1), Length=1)
random = Random(Range=dom, Number=number_slider_3, Seed=series)
Z_3 = UnitZ(Factor=number_slider_2)
Z_4 = UnitZ(Factor=number_slider_2)
ma = MassAddition(Input=random)  # -> Result, simplify(PartialResults)
moveaway = MoveAwayFrom(Geometry=arrlinear.Geometry, Emitter=line, Distance=ma.PartialResults)  # -> Geometry, Transform
extr = Extrude(Base=scale.Geometry, Direction=Z_3)
scale_2 = Scale(Geometry=cir_2, Center=Point(0, 0, 0), Factor=0.5)  # -> Geometry, Transform
extr_2 = Extrude(Base=cir, Direction=Z_4)
pline = PolyLine(Vertices=moveaway.Geometry, Closed=False)
cap = CapHoles(Brep=extr)
cap_2 = CapHoles(Brep=extr_2)
genes = GenePool(
    Decimals=2,
    Maximum=100,
    Minimum=0,
    Value=[62.33068858, 61.48399061, 44.12544791, 65.40557692, 52.64684697, 49.76191177, 38.33651245, 39.6110128, 54.65080307, 50.77680897])
number_slider_4 = Slider(10, range=1..100)
number_slider_5 = Slider(10, range=1..100)
number_slider_6 = Slider(10, range=1..100)
boundary = BoundarySurfaces(Edges=[scale_2.Geometry, cir_2])
smoothpline = SmoothPolyline(Polyline=pline, Strength=1, Times=Slider(3, range=0..10))
Z_5 = UnitZ(Factor=Slider(4, range=0..10))
series_2 = Series(Start=0, Step=1, Count=10)
sdiff = SolidDifference(BrepsA=cap_2, BrepsB=cap)
number_slider_7 = Slider(10, range=0..100)
number_slider_8 = Slider(1, range=0..1)
Z_6 = UnitZ(Factor=1)
extr_3 = Extrude(Base=boundary, Direction=Z_5)
bbox = BoundingBox(Content=extr_3, Plane=PlaneXY(0, 0, 0))  # -> Box, Box_2
debrep = DeconstructBrep(Brep=sdiff)  # -> Faces, Edges, Vertices
debox = DeconstructBox(Box=bbox.Box_2)  # -> Plane, X, Y, Z
vpipe = PipeVariable(Curve=smoothpline, Parameters=genes, Radii=series_2, Caps=0)
debrep_2 = DeconstructBrep(Brep=extr_3)  # -> Faces, Edges, Vertices
contour = Contour(Shape=sdiff, Point=Point(0, 0, 0), Direction=Vector(0, 0, 1), Distance=Z_6)  # -> simplify(Contours)
lng = ListLength(List=debox.Z)
lng_2 = ListLength(List=debox.Y)
lng_3 = ListLength(List=debox.X)
pipe = Pipe(Curve=smoothpline, Radius=1, Caps=0)
sdivide = DivideSurface(Surface=debrep_2.Faces, UCount=Slider(15, range=0..100), VCount=Slider(6, range=0..10))  # -> simplify(Points), Normals, Parameters
sdivide_2 = DivideSurface(Surface=debrep.Faces, UCount=number_slider_7, VCount=number_slider_7)  # -> simplify(Points), Normals, simplify(Parameters)
boundary_2 = BoundarySurfaces(Edges=contour)  # -> flatten(Surfaces)
division = Division(A=lng, B=number_slider_4)
division_2 = Division(A=lng_2, B=number_slider_6)
dedom2num = DeconstructDomain²(Domain=debox.X)  # -> UMin, UMax, VMin, VMax
dedom2num_2 = DeconstructDomain²(Domain=debox.Y)  # -> UMin, UMax, VMin, VMax
division_3 = Division(A=lng_3, B=number_slider_5)
vec = VectorXYZ(XComponent=0, YComponent=0, ZComponent=0)  # -> Vector, Length
neg = Negative(Value=sdivide.Normals)
addition = Addition(A=number_slider_5, B=1)
addition_2 = Addition(A=number_slider_6, B=1)
addition_3 = Addition(A=number_slider_4, B=1)
srfmorph = SurfaceMorph(Surface=debrep.Faces, UDomain=number_slider_8, VDomain=number_slider_8, WDomain=number_slider_8)
scale_nu = ScaleNU(Geometry=bbox.Box, Plane=PlaneXY(0, 0, 0), ScaleX=division_3, ScaleY=division_2, ScaleZ=division)  # -> Geometry, Transform
move = Move(Geometry=sdivide.Points, Motion=neg)  # -> Geometry, Transform
pline_2 = PolyLine(Vertices=sdivide_2.Points, Closed=True)
series_3 = Series(Start=0, Step=1, Count=10)
arrrec = RectangularArray(Geometry=vec.Vector, Cell={Plane=PlaneXY(0, 0, 0), Size=Domain2(u=0..10, v=0..5)}, XCount=6, YCount=3)  # -> Geometry, Transform
truebutton = TrueOnlyButton(LastSaveLocalization="neutral,N")
vec_2 = VectorXYZ(XComponent=dedom2num.UMin, YComponent=dedom2num_2.UMin, ZComponent=0)  # -> Vector, Length
clean = CleanTree(RemoveNulls=True, RemoveInvalid=True, RemoveEmpty=False, Tree=sdivide.Points)
pt = Point(vec_2.Vector)
line_2 = LineSDL(Start=sdivide_2.Points, Direction=sdivide_2.Normals, Length=1)  # -> simplify(Line)
item = ListItem(List=line_2, Index=Slider(0, range=0..10), Wrap=True)
pt_2 = Point(arrrec.Geometry)
pipe_2 = Pipe(Curve=pline_2, Radius=1, Caps=0)
popgeo = PopulateGeometry(Geometry=boundary_2, Count=Slider(5, range=0..100), Seed=1)  # -> simplify(Population)
arrbox = BoxArray(Geometry=vec_2.Vector, Cell=scale_nu.Geometry, XCount=addition, YCount=addition_2, ZCount=addition_3)  # -> Geometry, Transform
rotate = Rotate(Geometry=line_2, Angle=Slider(0.785, range=0..1), Plane=PlaneXY(0, 0, 0))  # -> Geometry, Transform
cir_3 = Circle(Plane=line_2, Radius=1)
cp = ClosestPoint(Point=popgeo, Cloud=popgeo)  # -> ClosestPoint, CPIndex, Distance
cir_4 = Circle(Plane=cp.ClosestPoint, Radius=1)
brepinc = PointInBrep(Brep=extr_3, Point=arrbox.Geometry, Strict=False)
flip = FlipMatrix(Data=cir_4)
cull = CullPattern(List=arrbox.Geometry, CullPattern=brepinc)
py3 = Python3Script(
    points=flatten(cull),
    max_len=Slider(20, range=0..100),
    max_dist=Slider(5, range=0..100),
    alpha=Slider(0.5, range=0..1),
    regen=truebutton)  # -> out, lines; inputs points: list of Point3d, max_len: Int32, max_angle: Double, max_dist: Double, alpha: Double, regen: Boolean
# ---------- py3: Python ----------
"""Grasshopper Script"""
import rhinoscriptsyntax as rs
import math
import random
from ghpythonlib import treehelpers as ght
# import numpy as np

# unused_points = []
# points = rs.GetPoints(True)
lines = []

def add(lhs, rhs):
    assert (len(lhs) == len(rhs))
    return [lhs[i] + rhs[i] for i in range(len(lhs))]

def sub(lhs, rhs):
    assert (len(lhs) == len(rhs))
    return [lhs[i] - rhs[i] for i in range(len(lhs))]

def mul(lhs, rhs):
    return [lhs*rhs[i] for i in range(len(rhs))]

def dot(l1, l2):
    assert(len(l1) == len(l2))
    return sum([l1[i]*l2[i] for i in range(len(l1))])

def norm(v):
    return math.sqrt(dot(v, v))

def normalize(vec):
    if (norm(vec) == 0): return [0,0,0]
    return [v / norm(vec) for v in vec]

def cos_distance(direction, start, ends):
    dists = []
    dir_norm = norm(direction)
    for end in ends:
        vec = end  - start
        v_norm = norm(vec)
        if (v_norm == 0 or dir_norm == 0):
            dists.append(-1)
            continue
        print(vec, direction)
        print(dot(vec, direction) / (v_norm * dir_norm))
        d = math.acos(dot(vec, direction) / (v_norm * dir_norm))
        dists.append(d)
        
    return dists

def dist(list1, list2):
    v = [l2 -l1 for l1, l2 in zip(list1, list2)]
    return math.sqrt(sum([vi**2 for vi in v]))

def make_line():
    # unused_points.copy(points)
    # rs.AddPolyline()
    line = []
    velocity = [[0,0,0], [0,0,0]]
    print(len(points))
    for i in range(max_len):
        if (len(points) <= 0): break

        nearby = []
        if (i > 0):
            # nearby = points
            for p in points:
                if dist(line[i-1], p) < max_dist: # AND not crossing empty space
                    nearby.append(p)
        else:
            nearby = points

        if (i < 2):
            next_p = nearby[random.randint(0, len(nearby)-1)]
        else:
            # velocity.append([line[i-1][ii] - line[i-2][ii] for ii in range(len(next_p))])
            velocity.append(normalize(sub(line[i-1], line[i-2])))
            acceleration = normalize(sub(velocity[i], velocity[i-1]))
            direction = add(mul(alpha, velocity[i]), mul(1-alpha, acceleration))
            # if i == 3: direction = velocity[i]
            # print(momentum)
            dists = cos_distance(direction, line[i-1], nearby)
            next_p = nearby[dists.index(min(dists))]
            # print("Here")

        line.append(next_p)
        if (next_p in points):
            points.remove(next_p)


    # print(line)
    # lines = line
    return line

def fill():
    ls = []
    # while (len(points) > 10):
    #     ls.append(make_line())
    for i in range(5):
        ls.append(make_line())

    return ls

lines = ght.list_to_tree(fill())
# ---------- end py3 ----------
panel = Panel(py3.lines)
item_2 = ListItem(List=py3.lines, Index=0, Wrap=True)
cullpt = CullDuplicates(Points=py3.lines, Tolerance=0.1, CullMode=3)  # -> Points, Indices, Valence
panel_2 = Panel(py3.out)
pline_3 = PolyLine(Vertices=cullpt.Points, Closed=False)
item_3 = ListItem(List=cp.ClosestPoint, Index=0, Wrap=True)
loft = Loft(Curves=flip, Options={Adjust=False, Closed=False, LoftEnds=0, LoftSimp=0, LoftType=0, Rebuild=10, Refit=0.01})
data = Data([item_2, pline_3])
item_4 = ListItem(List=loft, Index=0, Wrap=True)
smoothpline_2 = SmoothPolyline(Polyline=pline_3, Strength=1, Times=1)
pipe_3 = Pipe(Curve=smoothpline_2, Radius=Slider(0.6, range=0..1), Caps=0)
