# Grasshopper definition L2.gh (Grasshopper 1.0.8)

# ---- group: Object / Make Grid / Base Shape
outer_radius = Slider(4, range=-100..100)
thickness = Slider(1.6, range=0..10)
subtraction = Subtraction(A=outer_radius, B=thickness)
cir = Circle(Plane=PlaneXY(0, 0, 0), Radius=outer_radius)
polygon = Polygon(
    Plane=PlaneXY(0, 0, 0),
    Radius=Slider(1, range=0..100),
    Segments=Slider(4, range=0..100),
    FilletRadius=Slider(0, range=0..100))  # -> Polygon, Length
cir_2 = Circle(Plane=PlaneXY(0, 0, 0), Radius=subtraction)

# ---- group: Object / Make Grid
height = Slider(1, range=0..10)
num_layers = Slider(6, range=1..20)
per_layer = Slider(8, range=1..20)

# ----
X = UnitX(Factor=outer_radius)
geo = Geometry([cir_2, cir])
lng = ListLength(List=geo)
addition = Addition(A=lng, B=per_layer)
Z = UnitZ(Factor=height)

# ---- group: Object / Make Grid
move = Move(Geometry=polygon.Polygon, Motion=X)  # -> Geometry, Transform
arrpolar = PolarArray(Geometry=move.Geometry, Plane=PlaneXY(0, 0, 0), Count=per_layer, Angle=6.283185307)  # -> Geometry, Transform
geo_2 = Geometry([geo, arrpolar.Geometry])
flatten = FlattenTree(Tree=geo_2, Path="{0}")
arrlinear = LinearArray(Geometry=flatten, Direction=Z, Count=num_layers)  # -> Geometry, Transform

# ----
vec = VectorXYZ(XComponent=0, YComponent=0, ZComponent=Slider(0.1, range=0..10))  # -> Vector, Length
subtraction_2 = Subtraction(A=num_layers, B=Slider(1, range=0..1))
thickness_2 = Slider(1, range=0..10)
multiplication = Multiplication(A=height, B=subtraction_2)
xy = XYPlane(Origin=vec.Vector)
division = Division(A=multiplication, B=thickness_2)
planesrf = PlaneSurface(Plane=xy, XSize=Domain(-10, 10), YSize=Domain(-10, 10))
Z_2 = UnitZ(Factor=thickness_2)
round = Round(Number=division)  # -> Nearest, Floor, Ceiling
arrlinear_2 = LinearArray(Geometry=planesrf, Direction=Z_2, Count=round.Ceiling)  # -> Geometry, Transform
vec_2 = VectorXYZ(XComponent=0, YComponent=0, ZComponent=0)  # -> Vector, Length

# ---- group: Object
scale = Slider(0, range=0..10)
rotaton = Slider(0.098, range=-1.571..1.571)

# ---- group: Object / Rotate by layer
area = Area(Geometry=arrlinear.Geometry)  # -> Area, flatten(Centroid)
series = Series(Start=0, Step=rotaton, Count=num_layers)
avr = Average(Input=area.Centroid)
Z_3 = UnitZ(Factor=1)
addition_2 = Addition(A=avr, B=Z_3)
ln = Line(StartPoint=avr, EndPoint=addition_2)
rotax = RotateAxis(Geometry=arrlinear.Geometry, Angle=series, Axis=ln)  # -> Geometry, Transform

# ----
series_2 = Series(Start=1, Step=scale, Count=num_layers)

# ---- group: Object (continued)
partition = PartitionList(List=rotax.Geometry, Size=addition)

# ----
flatten_2 = FlattenTree(Tree=partition, Path="{0}")

# ---- group: Object / Scale by Layer
series_3 = Series(Start=0, Step=1, Count=num_layers)
series_4 = Series(Start=series_3, Step=num_layers, Count=addition)

# ----
item = ListItem(List=flatten_2, Index=series_4, Wrap=True)

# ---- group: Object / Scale by Layer (continued)
area_2 = Area(Geometry=item)  # -> Area, Centroid
avr_2 = Average(Input=area_2.Centroid)  # -> flatten(ArithmeticMean)
scale_2 = Scale(Geometry=partition, Center=avr_2, Factor=series_2)  # -> flatten(Geometry), Transform

# ----
partition_2 = PartitionList(List=scale_2.Geometry, Size=num_layers)

# ---- group: Object (continued)
loft = Loft(Curves=partition_2, Options={Adjust=False, Closed=False, LoftEnds=0, LoftSimp=0, LoftType=0, Rebuild=10, Refit=0.01})  # -> flatten(Loft)
item_2 = ListItem(List=loft, Index=Slider(1, range=0..10), Wrap=True)
item_3 = ListItem(List=loft, Index=Slider(0, range=0..10), Wrap=True)
cap = CapHoles(Brep=item_2)
cap_2 = CapHoles(Brep=item_3)
sdiff = SolidDifference(BrepsA=cap, BrepsB=cap_2)

# ----
lng_2 = ListLength(List=loft)
subtraction_3 = Subtraction(A=lng_2, B=Slider(2, range=0..10))
series_5 = Series(Start=2, Step=1, Count=subtraction_3)
item_4 = ListItem(List=loft, Index=series_5, Wrap=True)
cap_3 = CapHoles(Brep=item_4)
join = BrepJoin(Breps=[cap_3, sdiff])  # -> flatten(Breps), Closed

# ---- group: Object (continued)
sunion = SolidUnion(Breps=join.Breps)

# ----
bbx = BrepBrep(BrepA=sunion, BrepB=arrlinear_2.Geometry)  # -> Curves, Points
bbox = BoundingBox(Content=bbx.Curves, Plane=PlaneXY(0, 0, 0), UnionBox=True)  # -> Box, Box_2
movetoplane = MoveToPlane(Geometry=bbx.Curves, Plane=PlaneXY(0, 0, 0), Above=True, Below=True)  # -> Geometry, Transform
boxprop = BoxProperties(Box=bbox.Box)  # -> Center, Diagonal, Area, Volume, Degeneracy
vlen = VectorLength(Vector=boxprop.Diagonal)  # -> flatten(Length)
ma = MassAddition(Input=vlen)  # -> Result, PartialResults
X_2 = UnitX(Factor=ma.PartialResults)
lng_3 = ListLength(List=X_2)
subtraction_4 = Subtraction(A=lng_3, B=Slider(2, range=0..10))
subset = SubList(List=X_2, Domain=subtraction_4, Wrap=True)  # -> List, Index
unflatten = UnflattenTree(Tree=[vec_2.Vector, subset.List], Guide=bbox.Box)
move_2 = Move(Geometry=movetoplane.Geometry, Motion=unflatten)  # -> Geometry, Transform
